vi "MSpot Spectrum Calibration Subroutine.gvi"   [LabVIEW NXG 5.0.0]
inputs:
  "Error In": error
outputs:
  "Error Out": error
panel controls:
  "Stand Alone?": bool
  "Instrument Coms Info In": "Instrument Coms Info.gtype"
  "Beam Spectrum Calibration Parameters": "Measuring Spot Spectrum Calibration Parameters.gtype"
  "Rainbow Sweep Param Selector": "Rainbow Sweep Param Selector.gtype" = {0, 1100, 300, 1, 1, 0}
panel indicators:
  "Full Beam Multispectral Data Array": "Full Measuring Spot Multispectral Data.gtype"[]
types:
  T1 = cluster{"Element 1": "VISA Instr", "Element 2": string}
  "Arduino Detection cluster control.gtype" = cluster{"XZ Stage Arduino Address": "VISA Instr", "XZ Stage Arduino Detected?": bool, "Multiplexer Arduino Detected?": bool, "Multiplexer Arduino Address": "VISA Instr", "Arduinos List": T1[], "XZ Stage Log": string, "Multiplexer Log": string}
  "Thorlabs Motors Serial Number In.gtype" = cluster{"Thorlabs Blue Motor": string, "Thorlabs Red Motor": string, "Blue Motor Homed?": bool, "Red Motor Homed?": bool}
  "Instrument Coms Info.gtype" = cluster{"Arduino Coms Info": "Arduino Detection cluster control.gtype", "Photodetector Names": string[], "Keythley Address": "VISA Instr", "Photodetector Detected?": bool, "Thorlabs Motors Detected?": bool, "Keithley Detected?": bool, "Thorlabs Motors Serial Number": "Thorlabs Motors Serial Number In.gtype", "Photodetector IVI session": "Ivi IviDefault"}
  "Measuring Spot Spectrum Calibration Parameters.gtype" = cluster{"Min Position (mm)": f64, "Max Position (mm)": f64, "Position step size (mm)": f64}
  "Raibow Sweep Selector.gtype" = enum{"Red Sweep", "Blue Sweep", "Full Sweep Red First", "Full Sweep Blue First"}
  "Rainbow Sweep Type Selector.gtype" = cluster{"Red Sweep Mode": enum{"Red Sweep Closing", "Red Sweep Opening"}, "Blue Sweep Mode": enum{"Blue Sweep Opening", "Blue Sweep Closing"}}
  "Rainbow Sweep Param Selector.gtype" = cluster{"Raibow Sweep Selector": "Raibow Sweep Selector.gtype", "Max Wavelength (nm)": f64, "Min Wavelength (nm)": f64, "Wavelength Step (nm)": f64, "Rainbow Sweep Types": "Rainbow Sweep Type Selector.gtype"}
  "Measuring Spot Spectrum Data.gtype" = cluster{"Beam Spectrum": cluster{"Wavelength": f64[], "Counts": f64[]}, "Blue Motor Position (mm)": f64, "Red Motor Position (mm)": f64}
  "Rainbow Sweep Types.gtype" = enum{"Red Sweep Closing", "Red Sweep Opening", "Blue Sweep Closing", "Blue Sweep Opening"}
  "Full Measuring Spot Multispectral Data.gtype" = cluster{"Beam Spectrum Data Array": "Measuring Spot Spectrum Data.gtype"[], "Rainbow Sweep Types": "Rainbow Sweep Types.gtype"}
uses:
  Rainbow Measurement Setup::Main Functions::One Time Calibrations::Beam Power Density::Specific Detect Instruments Subroutine.gvi
  Rainbow Measurement Setup::Side Functions::Instrument Control::Thorlabs Motors::Movement::KCube Move to 0 or Home.gvi
  Rainbow Measurement Setup::Side Functions::Instrument Control::Arduino::XZ Stage Arduino::Low Level::XZ Stage Initialize.gvi
  Rainbow Measurement Setup::Side Functions::Instrument Control::Arduino::XZ Stage Arduino::XZ Stage Home Sequence.gvi
  LabView_NXG_Thorlabs_PM100::Examples::Photodetector initialization Sequence with prompt.gvi
  Rainbow Measurement Setup::Main Functions::One Time Calibrations::Measuring Spot Spectrum::Measuring Spot Spectrum Rainbow Sweep Subroutine.gvi
  Rainbow Measurement Setup::Main Functions::One Time Calibrations::Measuring Spot Spectrum::Measuring Spot Spectrum Visualizer.gvi
  Rainbow Measurement Setup::Side Functions::Global Abort::FGV Global Abort.gvi
diagram:
  w1 = $"Beam Spectrum Calibration Parameters"
  w2 = $"Rainbow Sweep Param Selector"
  w3 = $"Stand Alone?"
  # This subVI takes a full spectrum for each guillotine motor position and then changes the guillotine position and continues on taking spectra.
  # After all the spectra have been taken we are presented with the results to determine the dividing wavelength for each position and then we can
  # write down the dividing wavelength file.
  # Falta comunicar amb el flame :') DRAMA
  case ($"Error In") {
    frame Error, Default {
      w4 = $"Error In"
      w5 = default
    }
    frame No Error {
      s1 = $"Error In"  # shift register
      s2 = "Start App"  # shift register
      s3 = $"Instrument Coms Info In"  # shift register
      s4 = uninitialised  # shift register
      while {
        case (s2) {
          frame "Start App", Default {
            Select(s=w3, t="Detect Instruments", f="Initialize Instruments") -> w6
            w7 = s1
            w8 = s3
            w9 = s4
            w10 = default
          }
          frame "Detect Instruments" {
            call "Specific Detect Instruments Subroutine.gvi"(Instrument Coms Info In=s3, Error In=s1, Instruments To Detect Array=["Thorlabs Motors"], Stand Alone?=w3) -> (Instrument Coms Info Out=w8, Error Out=w7)
            w6 = "Initialize Instruments"
            w9 = s4
            w10 = default
          }
          frame "Initialize Instruments" {
            call "KCube Move to 0 or Home.gvi"(Instrument Coms Info In=s3, Error In=s1) -> (Instrument Coms Info Out=w11, Error Out=w12)
            disable {
              frame Enabled {
                w7 = w12
                w8 = w11
              }
              frame Disabled {
                Property Node(instance in=w11) -> ("Arduino Coms Info:XZ Stage Arduino Address"=w13, instance out=w14)
                call "XZ Stage Initialize.gvi"(XZ Carriage Arduino Adress In=w13, Error In=w12) -> (XZ Carriage Arduino Visa Session Out=w15, XZ Carriage Arduino Log=w16, Error Out=w17)
                call "XZ Stage Home Sequence.gvi"(XZ Carriage Arduino Open Visa Session In=w15, XZ Carriage Arduino Log In=w16, Error In=w17) -> (XZ Carriage Arduino Log Out=w18, Error Out=w19)
                call "Photodetector initialization Sequence with prompt.gvi"(Error In=w19) -> (Photodetector IVI session=w20, Error Out=w7)
                Property Node(instance in=w14, "Photodetector IVI session"=w20, "Arduino Coms Info:XZ Stage Log"=w18) -> (instance out=w8)
              }
            }
            w6 = "Rainbow Sweep"
            w9 = s4
            w10 = default
          }
          frame "Rainbow Sweep" {
            call "Measuring Spot Spectrum Rainbow Sweep Subroutine.gvi"(Instrument Coms Info In=s3, Beam Spectrum Calibration Parameters=w1, Rainbow Sweep Param Selector=w2, Error In=s1) -> (Instrument Coms Info Out=w8, Full Beam Multispectral Data Array=w9, Error Out=w7)
            w6 = "Close Coms"
            w10 = default
          }
          frame "Close Coms" {
            w6 = "Check Graphs"
            w7 = s1
            w8 = s3
            w9 = s4
            w10 = default
          }
          frame "Check Graphs" {
            call "Measuring Spot Spectrum Visualizer.gvi"(Full Beam Multispectral Data Array=s4, Error In=s1) -> (Error Out=w7)
            w6 = "Stop App"
            w8 = s3
            w9 = s4
            w10 = default
          }
          frame "Stop App" {
            w6 = "Start App"
            w7 = s1
            w8 = s3
            w9 = s4
            w10 = TRUE
          }
        }
        call "FGV Global Abort.gvi"(Global Abort Instructions="Read Current State", Error In=w7) -> (Local Abort Out=w21, Global Abort Out=w22, Error Out=w23)
        Logical Or(w21, w22, w10) -> w24
        next s1 = w23
        next s2 = w6
        next s3 = w8
        next s4 = w9
        stop if w24
      }
      w4 = s1
      w5 = s4
    }
  }
  $"Error Out" <- w4
  $"Full Beam Multispectral Data Array" <- w5
